# Grasshopper definition BeaverTest.gh (Grasshopper 1.0.7)
# plug-ins: Kangaroo2 Components, Ironbug.LBHB_Legacy, Human, Karamba3D, Beaver, LunchBox

# ----
# SELECT A BEAVER MATERIAL
path = FilePath("D:\Profissional\struktur.ark\Beaver\Examples\BeaverMaterials.csv")
nickname = Comp_ImportCSVMaterials(FilePath=path)
panel = Panel(nickname)
item = ListItem(List=nickname, Index=Slider(27, range=0..40), Wrap=True)  # -> flatten(Item)

matselect = MaterialSelectionKaramba3D(menu=[dropdown(5), dropdown(2)])
layer_ref = LayerReference(ReferenceToggle=Toggle(True), LayerName="Spans")  # -> Geometry, Name, UserStrings, GUID

# ---- group: FORM FINDING
# mesh
# supports
# dome center
# attractor
# GEOMETRY GENERATION
number_slider = Slider(10, range=0..10)
number_slider_2 = Slider(3, range=0..10)
pt = Point("0,0,0")
X = UnitX(Factor=1)
pi = Pi(Factor="2")
line = LineSDL(Start=pt, Direction=X, Length=number_slider)
multiplication = Multiplication(A="2", B=number_slider_2)
division = Division(A=pi, B=multiplication)
rad = Radians(Degrees=Slider(30, range=0..180))
rotate = Rotate(Geometry=line, Angle=division, Plane=PlaneXY(0, 0, 0))  # -> Geometry, Transform
end = EndPoints(Curve=line)  # -> Start, End
end_2 = EndPoints(Curve=rotate.Geometry)  # -> Start, End
ln = Line(StartPoint=end.End, EndPoint=end_2.End)
eval = EvaluateCurve(Curve=rotate.Geometry, Parameter=Slider(0.3, range=0..1))  # -> Point, Tangent, Angle
eval_2 = EvaluateCurve(Curve=ln, Parameter=Slider(0.1, range=0..1))  # -> Point, Tangent, Angle
srf4pt = _4PointSurface(CornerA=end.Start, CornerB=eval.Point, CornerC=eval_2.Point, CornerD=end.End)
mesh = Mesh(srf4pt)
xz = XZPlane(Origin=Point(0, 0, 0))
mirror = Mirror(Geometry=mesh, Plane=xz)  # -> Geometry, Transform
pt_2 = Point(end_2.End)
mjoin = MeshJoin(Meshes=[mesh, mirror.Geometry])
arrpolar = PolarArray(Geometry=mjoin, Plane=PlaneXY(0, 0, 0), Count=number_slider_2, Angle=6.283185307)  # -> flatten(Geometry), Transform
mjoin_2 = MeshJoin(Meshes=arrpolar.Geometry)
arrpolar_2 = PolarArray(Geometry=mjoin_2, Plane=pt_2, Count=number_slider_2, Angle=6.283185307)  # -> Geometry, Transform
refine = Refine(Mesh=arrpolar_2.Geometry, Level="1")
pt_3 = Point(pt_2)  # disabled
number_slider_3 = Slider(10, range=0..10)  # disabled
nv = NakedVertices(Mesh=refine)  # -> ClothedIndex, NakedIndex, ClothedPts, NakedPts
area = Area(Geometry=refine)  # -> Area, Centroid
mjoin_3 = MeshJoin(Meshes=refine)  # disabled
Z = UnitZ(Factor=number_slider_3)  # disabled
number_slider_4 = Slider(0, range=0..1)  # disabled
move = Move(Geometry=pt_3, Motion=Z)  # -> Geometry, Transform; disabled
number_slider_5 = Slider(100, range=0..100)  # disabled
dist = Distance(PointA=nv.NakedPts, PointB=graft(area.Centroid))
nv_2 = NakedVertices(Mesh=mjoin_3)  # -> ClothedIndex, NakedIndex, ClothedPts, NakedPts; disabled
edgelengths = EdgeLengths(Mesh=mjoin_3, LengthFactor=number_slider_4, Strength=number_slider_5)  # disabled
cir = Circle(Plane=move.Geometry, Radius=1)  # disabled
show = Show(G=mjoin_3)  # disabled
larger = LargerThan(FirstNumber=dist, SecondNumber=Slider(8.8, range=0..10))  # -> LargerThan, OrEqualTo
cull = CullPattern(List=nv.NakedPts, CullPattern=larger.LargerThan)
dist_2 = Distance(PointA=nv.NakedPts, PointB=graft(pt_3))
cullpt = CullDuplicates(Points=cull, Tolerance=0.1, CullMode=3)  # -> flatten(Points), Indices, Valence
number_slider_6 = Slider(10, range=0..10)  # disabled
number_slider_7 = Slider(33, range=0..100)  # disabled
Z_2 = UnitZ(Factor=1)  # disabled
smaller = SmallerThan(FirstNumber=dist_2, SecondNumber=Slider(10, range=0..10))  # -> SmallerThan, OrEqualTo
cull_2 = CullPattern(List=nv.NakedPts, CullPattern=smaller.SmallerThan)  # disabled
panel_2 = Panel("1000000")  # disabled
load = Load(Point=nv_2.ClothedPts, ForceVector=Z_2, Weighting=number_slider_6)  # disabled
cullpt_2 = CullDuplicates(Points=cull_2, Tolerance=0.1, CullMode=3)  # -> flatten(Points), Indices, Valence; disabled
oncurve = OnCurve(Points=cullpt_2.Points, Curve=cir, Strength=number_slider_7)  # disabled
anchor = Anchor(Point=cullpt.Points, Strength=panel_2)  # disabled
falsestart = Ladybug_FalseStartToggle(False)  # disabled
button = Button()  # disabled
solver = Solver(GoalObjects=[edgelengths, show, anchor, load, oncurve], Reset=button, Threshold=1e-15, Tolerance=0.0001, On=falsestart)  # -> I, V, O; disabled
sortbytype = SortObjectsByType(RhinoObjects=solver.O)  # -> Points, Curves, Surfaces, Breps, Meshes, TextObjects, HatchObjects, LightObjects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; disabled

# ----
mesh_2 = Mesh(flatten(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))
matselect_2 = MaterialSelectionKaramba3D(menu=[dropdown(5), dropdown(1)])
crv = Curve(layer_ref.Geometry)

# ----
# CONVERT IT INTO
# A KARAMBA MATERIAL
b2kmat = BeaverToKarambaMaterial(BeaverMaterial=item)

medges = MeshEdges(Mesh=mesh_2)  # -> NakedEdges, InteriorEdges, NonManifoldEdges

# ---- group: internal
crv_2 = Curve(medges.InteriorEdges)

# ---- group: edges
crv_3 = Curve(medges.NakedEdges)

# ----
cross_section = CrossSectionKaramba3D(FamilyNameOfCrossSection="DefaultCroSec", Material=matselect_2, Height_cm=1, mode="Shell - Const")

# ---- group: FINDS THE ACTUAL SPAN LENGTH FOR SLS ANALYSIS
midpt = CurveMiddle(Curve=crv_2)  # -> graft(Midpoint)
panel_3 = Panel("0.01")
crv_cp = CurveClosestPoint(Point=midpt, Curve=crv)  # -> Point, Parameter, Distance
end_3 = EndPoints(Curve=crv)  # -> Start, End
smaller_2 = SmallerThan(FirstNumber=crv_cp.Distance, SecondNumber=panel_3)  # -> SmallerThan, OrEqualTo
dist_3 = Distance(PointA=end_3.Start, PointB=end_3.End)
cull_3 = CullPattern(List=crv, CullPattern=smaller_2.OrEqualTo)  # -> flatten(List)
panel_4 = Panel(cull_3)

midpt_2 = CurveMiddle(Curve=crv_3)  # -> graft(Midpoint)
crv_cp_2 = CurveClosestPoint(Point=midpt_2, Curve=crv)  # -> Point, Parameter, Distance
end_4 = EndPoints(Curve=crv)  # -> Start, End
smaller_3 = SmallerThan(FirstNumber=crv_cp_2.Distance, SecondNumber=panel_3)  # -> SmallerThan, OrEqualTo
dist_4 = Distance(PointA=end_4.Start, PointB=end_4.End)
cull_4 = CullPattern(List=crv, CullPattern=smaller_3.OrEqualTo)  # -> flatten(List)
panel_5 = Panel(cull_4)

# ----
meshtoshell = MeshToShellKaramba3D(Mesh=mesh_2, CrossSection=cross_section, LimitDistance_m=0.005, Bending=False)  # -> Element, Points, Info
pt_4 = Point(cullpt.Points)
len = Length(Curve=medges.NakedEdges)
len_2 = Length(Curve=medges.InteriorEdges)
supp = SupportKaramba3D(PosInd=pt_4, menu=[buttons(on, on, on, off, off, off)])
cross_section_2 = CrossSectionKaramba3D(
    FamilyNameOfCrossSection="DefaultCroSec",
    Material=b2kmat,
    Height_cm="18",
    UpperFlangeWidth_cm="10",
    LowerFlangeWidth_cm="10",
    mode="Trapezoid")
cross_section_3 = CrossSectionKaramba3D(
    FamilyNameOfCrossSection="DefaultCroSec",
    Material=b2kmat,
    Height_cm="20",
    UpperFlangeWidth_cm="10",
    LowerFlangeWidth_cm="10",
    mode="Trapezoid")

# ---- group: CHECK IF IT WORKS
number_slider_8 = Slider(106, range=0..200)  # disabled
item_2 = ListItem(List=cull_4, Index=number_slider_8, Wrap=True)  # disabled
item_3 = ListItem(List=crv_3, Index=number_slider_8, Wrap=True)  # disabled
explode = Explode(Curve=item_2, Recursive=True)  # -> Segments, Vertices; disabled

# ----
loads = LoadsKaramba3D(Vector=Vector(0, 0, -1), LCase="P", mode="Gravity")
# ADD BEAVER
# PARAMETERS
# TO ELEMENTS
linetobeam = LineToBeamKaramba3D(
    Line=medges.InteriorEdges,
    Identifier="internal",
    CrossSection=cross_section_2,
    New=True,
    Remove=True,
    LimitDistance_m=0.005,
    Bending=True,
    SetBucklingLength=True,
    ToPolylineMaxAngle=0.03,
    ToPolylineTolerance=0.01,
    ToPolylineMinEdgeLength=0.25)  # -> Element, Points, Info
linetobeam_2 = LineToBeamKaramba3D(
    Line=medges.NakedEdges,
    Identifier="edges",
    CrossSection=cross_section_3,
    New=True,
    Remove=True,
    LimitDistance_m=0.005,
    Bending=True,
    SetBucklingLength=True,
    ToPolylineMaxAngle=0.03,
    ToPolylineTolerance=0.01,
    ToPolylineMinEdgeLength=0.25)  # -> Element, Points, Info
Z_3 = UnitZ(Factor="-0.3")
Z_4 = UnitZ(Factor="-1")
loads_2 = LoadsKaramba3D(Vector=Z_3, Mesh=mesh_2, LCase="W", mode="MeshLoad -Const.", menu=[buttons(off, off, on), buttons(on, off)])
loads_3 = LoadsKaramba3D(Vector=Z_4, Mesh=mesh_2, LCase="QA", mode="MeshLoad -Const.", menu=[buttons(off, off, on), buttons(on, off)])
addbeaverparams = KarambaAddBeaverParameters(
    Beam=linetobeam.Element,
    SpanLength=cull_3,
    BucklingLengthY=len_2,
    BucklingLengthZ=len_2,
    BucklingLengthLT=len_2,
    Cantilever=False,
    ServiceClass=2,
    Precamber=0,
    Local=True)
b2kbeams = KarambaAddBeaverParameters(
    Beam=linetobeam_2.Element,
    SpanLine=cull_4,
    BucklingLengthY=len,
    BucklingLengthZ=len,
    BucklingLengthLT=len_2,
    Cantilever=False,
    ServiceClass=2,
    Precamber=0,
    Local=False)
# RUN
# KARAMBA ANALYSIS
assemble = AssembleModelKaramba3D(
    Elem=[addbeaverparams, b2kbeams, meshtoshell.Element],
    Support=supp,
    Load=[loads, loads_3, loads_2],
    LimitDistance_m=0.005)  # -> Model, Info, Mass_kg, CenterOfGravity, LoadCaseNames
lng = ListLength(List=b2kbeams)
lng_2 = ListLength(List=addbeaverparams)
addition = Addition(A=lng_2, B=lng)
series = Series(Start=0, Step=1, Count=addition)
analyze = AnalyzeKaramba3D(Model=assemble.Model)  # -> CalculatedModel, MaximumDisplacement_cm, ResultingForceOfGravity_kN, ElasticEnergyChange_kNm
panel_6 = Panel("""P
QA
W""")
# DISPLAY KARAMBA RESULTS
modelview = ModelViewKaramba3D(Model=analyze.CalculatedModel, ResultFactors=1, ResultCase=-1)  # -> Model, DeformedMesh, DeformedAxes, DeformedModel
beamview = BeamViewKaramba3D(Model=modelview.Model)  # -> Model, MeshesOfRenderedBeams, DeformedBeamAxes, LegendColors, LegendTags
legend = Legend(
    Colour=beamview.LegendColors,
    Tags=beamview.LegendTags,
    Rectangle={Plane=PlaneXY(-10.2767964, 8.52262475, 0), Size=Domain2(u=-1.919640395..1.919640395, v=-5.028908498..5.028908498)},
    LegendType=1)
mesh_3 = Mesh(sortbytype.Meshes)  # disabled

# ----
# DISPLAY RESULTS
# BEAVER
# IMPORT TO BEAVER
# VERIFY CROSSECTIONS
falsestart_2 = Ladybug_FalseStartToggle(True)
panel_7 = Panel("""P
QA""")
k2b = KarambaToBeaver(
    KarambaModel=analyze.CalculatedModel,
    BeamIdentifiers=series,
    NumberOfResultsPerBeamElement="3",
    LoadCaseType=panel_6,
    Run=falsestart_2)
type = ValueList({"All", "SLS", "AllULS", "Tension", "Compression", "BiaxialBending", "Shear", "Torsion", "TensionAndBending", "CompressionAndBending", "CompressionAndBendingColumn", "CompressionAndBendingBeam", "TorsionAndShear"}, selected="All")
nickname_2 = TimberFrameView(TimberFrames=k2b, UtilizationType=type)  # -> Mesh, LegendT, LegendC, MaximumUtilization
viewports = ViewportProperties(Update=Button(), AutoUpdate=True)  # -> ViewportNames, ActiveViewportIndex, ViewportBounds, ViewportDisplayMode, CameraLocation, CameraTarget, CameraPlane, CameraLensLength, CameraProjection, CameraUp
item_4 = ListItem(List=viewports.CameraPlane, Index=Slider(0, range=0..5), Wrap=True)
expression = Expression(x=nickname_2.MaximumUtilization, Expression="Format(\"{0}{1:0,#} {2}\",\"Max Utilization: \", x*100,\"%\")")

criticalcheck = VisualizeCriticalCheck(TimberFrames=k2b)  # -> Mesh, LegendT, LegendC
medges_2 = MeshEdges(Mesh=nickname_2.Mesh)  # -> NakedEdges, InteriorEdges, NonManifoldEdges
mesh_4 = Mesh(nickname_2.Mesh)

# ---- group: Set Position on View
cluster = Cluster(pln=item_4, B_3=Slider(-4, range=-15..15), B_2=Slider(-6, range=-20..20), B=Slider(-20, range=-20..20))

cluster_2 = Cluster(pln=item_4, B_3=Slider(-0.4, range=-15..20), B_2=Slider(-1.45, range=-20..20), B=Slider(-5, range=-20..20))

# ----
rectangle = Rectangle(Plane=cluster, XSize=Slider(1, range=0..10), YSize=Slider(4, range=0..10), Radius=0)  # -> Rectangle, Length
tag = TextTag(Location=cluster_2, Text=expression, Colour=RGB(0, 0, 0))
legend_2 = Legend(Colour=nickname_2.LegendC, Tags=nickname_2.LegendT, Rectangle=rectangle.Rectangle, LegendType=1)

# ==== cluster Cluster
B = ClusterInput()
B_2 = ClusterInput()
B_3 = ClusterInput()
pln = ClusterInput()
pln_2 = Plane(pln)
deplane = DeconstructPlane(Plane=pln_2)  # -> Origin, XAxis, YAxis, ZAxis
multiplication = Multiplication(A=deplane.YAxis, B=B_2)
multiplication_2 = Multiplication(A=deplane.XAxis, B=B_3)
multiplication_3 = Multiplication(A=deplane.ZAxis, B=B)
addition = Addition(A=multiplication_2, B=multiplication, C=multiplication_3)
move = Move(Geometry=pln_2, Motion=addition)  # -> Geometry, Transform
G = ClusterOutput(move.Geometry)
