# Grasshopper definition ShearConnection.gh (Grasshopper 1.0.7)
# plug-ins: Beaver

a1v = Slider(0.05, range=0..0.1)
npar = Slider(4, range=0..10)
nperp = Slider(4, range=0..10)
a1h = Slider(0.05, range=0..0.1)
bmat = Material(
    Name="GL24c",
    Type="Glulam",
    BendingResistance=24,
    ParallelTensionResistence=17,
    PerpendicularTensionResistence=0.5,
    PalallelCompressionResistence=21.5,
    PerpendicularCompressionResistence=2.5,
    ShearResistence=3.5,
    MeanModulusOfElasticityParallel=11000,
    _5ModulusOfElasticityParallel=9100,
    MeanModulusOfElasticityPerpendicular=300,
    MeanModulusOfElasticityShear=650,
    _5ModulusOfElasticityShear=540)
bmat_2 = Material(
    Name="GL24c",
    Type="Glulam",
    BendingResistance=24,
    ParallelTensionResistence=17,
    PerpendicularTensionResistence=0.5,
    PalallelCompressionResistence=21.5,
    PerpendicularCompressionResistence=2.5,
    ShearResistence=3.5,
    MeanModulusOfElasticityParallel=11000,
    _5ModulusOfElasticityParallel=9100,
    MeanModulusOfElasticityPerpendicular=300,
    MeanModulusOfElasticityShear=650,
    _5ModulusOfElasticityShear=540)
bmat_3 = Material(
    Name="GL24c",
    Type="Glulam",
    BendingResistance=24,
    ParallelTensionResistence=17,
    PerpendicularTensionResistence=0.5,
    PalallelCompressionResistence=21.5,
    PerpendicularCompressionResistence=2.5,
    ShearResistence=3.5,
    MeanModulusOfElasticityParallel=11000,
    _5ModulusOfElasticityParallel=9100,
    MeanModulusOfElasticityPerpendicular=300,
    MeanModulusOfElasticityShear=650,
    _5ModulusOfElasticityShear=540)
bmat_4 = Material(
    Name="GL24c",
    Type="Glulam",
    BendingResistance=24,
    ParallelTensionResistence=17,
    PerpendicularTensionResistence=0.5,
    PalallelCompressionResistence=21.5,
    PerpendicularCompressionResistence=2.5,
    ShearResistence=3.5,
    MeanModulusOfElasticityParallel=11000,
    _5ModulusOfElasticityParallel=9100,
    MeanModulusOfElasticityPerpendicular=300,
    MeanModulusOfElasticityShear=650,
    _5ModulusOfElasticityShear=540)
bmat_5 = Material(
    Name="GL24c",
    Type="Glulam",
    BendingResistance=24,
    ParallelTensionResistence=17,
    PerpendicularTensionResistence=0.5,
    PalallelCompressionResistence=21.5,
    PerpendicularCompressionResistence=2.5,
    ShearResistence=3.5,
    MeanModulusOfElasticityParallel=11000,
    _5ModulusOfElasticityParallel=9100,
    MeanModulusOfElasticityPerpendicular=300,
    MeanModulusOfElasticityShear=650,
    _5ModulusOfElasticityShear=540)
pt = Point(Point(0, 0, 0))
number_slider = Slider(10, range=0..10)
type = ValueList({"Rectangular": "rectangular", "Circular": "circular"}, selected="Rectangular")
type_2 = ValueList({"Rectangular": "rectangular", "Circular": "circular"}, selected="Rectangular")
type_3 = ValueList({"Dowel", "Screw", "Bolt", "Nail"}, selected="Screw")
arrange_fast = ARRANGEFAST(G=pt, N=a1v, C=npar, N_2=a1h, C_2=nperp)
cs = CrossSection(Type=type, Material=bmat)
force = Force(NormalForce=0, ShearForceY=0, ShearForceZ=0, TorsionalMoment=0, BendingMomentY=0, BendingMomentZ=0, LoadCaseType="P")
force_2 = Force(NormalForce=0, ShearForceY=0, ShearForceZ="5", TorsionalMoment=0, BendingMomentY=0, BendingMomentZ=0, LoadCaseType="P")
disp = Comp_Displacement(DisplacementX=0, DisplacementY=0, DisplacementZ=0, LoadCaseType="P")
disp_2 = Comp_Displacement(DisplacementX=0, DisplacementY=0, DisplacementZ=0, LoadCaseType="P")
fast = Fastener(
    FastenerType=type_3,
    NominalDiameter=Slider(0.3, range=0..1),
    ShankDiameter=Slider(0.3, range=0..1),
    HeadDiameter=Slider(0.3, range=0..1),
    FastenerLength=Slider(0.3, range=0..1),
    SmoothBoolean=Slider(0.3, range=0..1),
    FastenerFu=800000000)
cs_2 = CrossSection(Type=type_2, Material=bmat_2, Height=number_slider, Width=number_slider)
xz = XZPlane(Origin=Point(0, 0, 0))
spacings = ShearConnectionSpacings(Npar=npar, Nperp=nperp, Stagger=False, A1=a1v, A2=a1v, A3=a1v, A4=a1v, Plane=xz)
t2t = TimberToTimberConnection(
    Fastener=fast,
    PreDrilled1="true",
    PreDrilled2="true",
    Alpha1="0",
    Alpha2="90",
    T1="15",
    T2="15",
    Mat1=bmat_5,
    Mat2=bmat_5,
    ShearPlanes="1",
    RopeEffect="true")  # -> FastenerCapacity, Fastener
framepoint = TimberFramePoint(
    CrossSection=[cs_2, cs],
    Forces=[force_2, force],
    DisplacementVector=[disp_2, disp],
    BucklingLenghtY=3,
    BucklingLenghtZ=3,
    SpanLenght=3,
    PreCamber=0,
    Cantilever=False,
    SpanLimitRange=0.5,
    ServiceClass="2")
semirigidconnection_using_a_free_center = SemiRigidConnection(Plane=xz, Points=arrange_fast, Fastener=fast, Spacing=spacings, TimberFramePoint=framepoint, T1="0.15", T2="0.15")  # -> Points, Vector, Value, Utilization; "SemiRigidConnection using a FREE CENTER OF ROTATION hypothesis"; disabled

# ==== cluster ARRANGEFAST
N = ClusterInput()
C = ClusterInput()
N_2 = ClusterInput()
C_2 = ClusterInput()
series = Series(Start=0, Step=N, Count=C)
series_2 = Series(Start=0, Step=N_2, Count=C_2)
G = ClusterInput()
X = UnitX(Factor=series)
Z = UnitZ(Factor=series_2)
move = Move(Geometry=G, Motion=X)  # -> graft(Geometry), Transform
move_2 = Move(Geometry=move.Geometry, Motion=Z)  # -> Geometry, Transform
pt = Point(flatten(move_2.Geometry))
pt_2 = ClusterOutput(pt)
